# Grasshopper definition AreaTag.gh (Grasshopper 0.9.75)

srf = Surface([<surface referenced from the Rhino model> x4])
md_slider = MDSlider(
    slider_value=Point(0.5000001861, 0.2463416123, 0.5),
    SliderMode=0,
    x_domain=Domain(-10, 10),
    y_domain=Domain(-10, 10),
    z_domain=Domain(0, 1))
area = Area(Geometry=srf)  # -> Area, Centroid
xy = XYPlane(Origin=area.Centroid)
rotate = Rotate(Geometry=xy, Angle=1.570796327, Plane=xy)  # -> Geometry, Transform
format = Format(Format="{0:0} in^2", Culture=127, Data0=area.Area)
move = Move(Geometry=rotate.Geometry, Motion=md_slider)  # -> Geometry, Transform
tag = TextTag3D(Location=move.Geometry, Text=format, Size=Slider(2, range=0..10), Justification=7)
