# Grasshopper definition CenterLines.gh (Grasshopper 0.9.75)

brep = Brep([<brep referenced from the Rhino model> x3])
mesh = Mesh([<mesh referenced from the Rhino model> x152])
bbox = BoundingBox(Content=mesh, Plane=PlaneXY(0, 0, 0))  # -> Box, Box_2
debox = DeconstructBox(Box=bbox.Box)  # -> Plane, X, Y, Z
volume = Volume(Geometry=simplify(graft(bbox.Box)))  # -> Volume, Centroid
entwine = Entwine(Branch00=debox.X, Branch01=debox.Y, Branch02=debox.Z)  # -> simplify(Result)
flip = FlipMatrix(Data=entwine)
Z = UnitZ(Factor=1)
Y = UnitY(Factor=1)
X = UnitX(Factor=1)
dedomain = DeconstructDomain(Domain=flip)  # -> Start, End
merge = Merge(Data1=X, Data2=Y, Data3=Z)
subtraction = Subtraction(A=dedomain.End, B=dedomain.Start)
sort = SortList(Keys=subtraction, ValuesA=merge)  # -> Keys, ValuesA
item = ListItem(List=sort.Keys, Index=2, Wrap=True)
item_2 = ListItem(List=sort.ValuesA, Index=2, Wrap=True)
panel = Panel("""1
-1""")
dup = DuplicateData(Data=item, Number=2, Order=True)
multiplication = Multiplication(A=dup, B=panel)
line = LineSDL(Start=volume.Centroid, Direction=item_2, Length=expr("x/2", multiplication))
join = JoinCurves(Curves=line, Preserve=False)
simplify = SimplifyCurve(Curve=join)  # -> Curve, Simplified
