# Grasshopper definition KangaNet.gh (Grasshopper 0.9.75)
# plug-ins: Kangaroo Components

crv = Curve(<curve referenced from the Rhino model>)
mplane = MeshPlane(Boundary=crv, WidthCount=Slider(36, range=0..100), HeightCount=Slider(11, range=0..100))  # -> Mesh, Area
corners = Corners(mesh=mplane.Mesh)
warpweft = WarpWeft(Mesh=mplane.Mesh)  # -> Warp, Weft, NakedA, NakedB
demesh = DeconstructMesh(Mesh=mplane.Mesh)  # -> Vertices, Faces, Colours, Normals
number_slider = Slider(0.51, range=0..5)
lng = ListLength(List=warpweft.Warp)
lng_2 = ListLength(List=warpweft.Weft)
crv_2 = Curve([warpweft.Weft, warpweft.Warp])
multiplication = Multiplication(A=number_slider, B=Slider(4, range=0..4))
dup = DuplicateData(Data=number_slider, Number=lng, Order=True)
dup_2 = DuplicateData(Data=multiplication, Number=lng_2, Order=True)
len = Length(Curve=crv_2)
multiplication_2 = Multiplication(A=len, B=[dup, dup_2])
springs = SpringsFromLine(Connection=crv_2, Stiffness=1000, Damping=10, RestLength=multiplication_2, UpperCutoff=0, LowerCutoff=0, Plasticity=0)
Z = UnitZ(Factor=9.8)
uforce = UnaryForce(Point=demesh.Vertices, Force=Z)
timer = Timer(TimerInterval=1, Target=kangaroo)
kangaroo = KangarooPhysics(
    ForceObjects=flatten([springs, uforce]),
    AnchorPoints=corners,
    Settings=null,
    Geometry=mplane.Mesh,
    SimulationReset=Toggle(False))  # -> Out, Iterations, ParticlesOut, GeometryOut
mesh = Mesh(kangaroo.GeometryOut)

# ==== cluster Corners: Find the boundary corner points of a quad mesh
mesh = ClusterInput()
mesh_2 = Mesh(mesh)
nv = NakedVertices(Mesh=mesh_2)  # -> ClothedIndex, NakedIndex, ClothedPts, NakedPts
vn = VertexNeighbours(Mesh=mesh_2, VertexNumber=nv.NakedIndex)  # -> graft(Vertex), Neighbours, Normal
lng = ListLength(List=vn.Neighbours)
equals = Equality(FirstNumber=lng, SecondNumber=3)  # -> Equality, Inequality
cull = CullPattern(List=vn.Vertex, CullPattern=equals.Inequality)
pshift = ShiftPaths(Data=cull, Offset=-1)
D = ClusterOutput(pshift)
