# Grasshopper definition PulloutCones_AppD.gh (Grasshopper 0.9.75)
# plug-ins: Python Interpreter

# ---- group: Vertical anchor bolts from points on face
anchor_heads = Point([<point referenced from the Rhino model> x5])
anchor_length = Slider(10, range=0..20)
Z = UnitZ(Factor=-1)
multiplication = Multiplication(A=anchor_length, B=Z)
move = Move(Geometry=anchor_heads, Motion=multiplication)  # -> Geometry, Transform
ln = Line(StartPoint=anchor_heads, EndPoint=move.Geometry)

# ---- group: general anchor bolts from curves
# Curves should start
# at face of concrete
anchors = Curve([<curve referenced from the Rhino model> x5])

# ----
from_points = BooleanToggle(True)
filter = StreamFilter(Gate=from_points, Stream0=anchors, Stream1=ln)
cone_angle = Slider(30, range=0..90)

# ----
# Concrete
# Anchors
concrete = Brep(<brep referenced from the Rhino model>)
anchors_2 = Curve(filter)

fail_cones = DeterminFailureArea(anchors=anchors_2, failure_cone_angle=cone_angle, concrete_volume=concrete, calculate_3d_cones=Toggle(True))  # -> projected_area, failure_cones, conic_area
area = Number(fail_cones.projected_area)

normal_weight_concrete = Slider(1, range=0..1)
len = Length(Curve=anchors_2)
avr = Average(Input=len)
python = PythonScript(
    A_nc=area,
    h_ef=avr,
    castIn=Toggle(True),
    f_c=Slider(6556, range=0..10000),
    normWeight=normal_weight_concrete,
    e_n=Slider(0, range=0..100))  # -> out, report, N_cb
# ---------- python: Python ----------
import rhinoscriptsyntax as r
import datetime

#Convert all document lengths to inches
A_nc = A_nc * pow(r.UnitScale(8),2)
h_ef = h_ef * r.UnitScale(8)
e_n = e_n * r.UnitScale(8)

#Compute area of a single ideal anchor
A_nco = 9 * pow( h_ef, 2)

#Apply factor for cast in place
# vs. post installed anchors
if castIn:
  k_c = 24
  placement = 'Cast in place'
else:
  k_c = 17
  placement = 'Post installed'

# 
N_b = k_c * normWeight * pow(f_c, 1/2) * 1.5 * h_ef

#Get all those gammas. This part needs work.
g_ec = 1 / (1 + (2 * e_n / 3 * h_ef))
g_ed = 1.0
g_c = 1.0
g_cp = 1.0

N_cb = ( A_nc / A_nco ) * g_ec * g_ed * g_c * g_cp * N_b

report = """Embedded anchor pullout calculation according to ACI Appendix D:
Calculated on {}
Assuming the following properties:
    {} concrete
    f'_c        = {:.4g} psi
    
    {} anchors
    e_n         = {:.3g} in
    h_ef        = {:.3g} in
    
    Gamma ec    = {:.3g}
    Gamma ed    = {:.3g}
    Gamma c     = {:.3g}
    Gamma cp    = {:.3g}
    
Nominal projected area of a single anchor pullout cone = {:.4g} in^2
Projected area of anchor group                         = {:.4g} in^2

Pullout strength of anchor group                       = {:.5g} kip
""".format(
    datetime.datetime.now().strftime("%Y-%m-%d"),
    'Normal weight' if normWeight else 'Light weight',
    f_c,
    placement,
    e_n,
    h_ef,
    g_ec,
    g_ed,
    g_c,
    g_cp,
    A_nc,
    A_nco,
    N_cb/1000
    )
# ---------- end python ----------
panel = Panel(python.report)
n_cb_lb = Panel(python.N_cb)

a_nc_in_2 = Panel(area)

# ==== cluster DeterminFailureArea: Generates the predicted failure surface for an anchor group pulled in tension out of a mass of concrete.
calculate_3d_cones = ClusterInput()  # If 'True' cones will be booleaned in 3D. This is slow, but good for visualization.
failure_cone_angle = ClusterInput()  # Failure cone angle (degrees)
concrete_volume = ClusterInput()  # The volume of concrete into which the anchors are embedded
anchors = ClusterInput()  # Anchors as curves

# ---- group: Create gross failure surface cones
len = Length(Curve=anchors)
vec = Vector(anchors)
pframe = PerpFrame(Curve=reparameterize(anchors), Parameter=0)
multiplication = Multiplication(A=vec, B=len)
multiplication_2 = Multiplication(A=len, B=2)
multiplication_3 = Multiplication(A=failure_cone_angle, B=0.01745329252)
tan = Tangent(Value=multiplication_3)
rev = Reverse(Vector=multiplication)
division = Division(A=multiplication_2, B=tan)
move = Move(Geometry=pframe, Motion=rev)  # -> Geometry, Transform
cone = Cone(Base=move.Geometry, Radius=division, Length=multiplication_2)  # -> Cone, Tip
sint = SolidIntersection(BrepsA=cone.Cone, BrepsB=concrete_volume)
gate = StreamGate(Stream=sint, Gate=calculate_3d_cones)  # -> Target0, Target1

# ----
# If this boolean fails, anchors are close together relative
# to their length. Try using only enough
# anchors to define the pullout cone.
sunion = SolidUnion(Breps=gate.Target1)
debrep = DeconstructBrep(Brep=sunion)  # -> Faces, Edges, Vertices

debrep_2 = DeconstructBrep(Brep=[gate.Target1, gate.Target0])  # -> Faces, Edges, Vertices
untrim = Untrim(Surface=debrep_2.Faces)
dim = Dimensions(Surface=untrim)  # -> UDimension, VDimension
dim_2 = Dimensions(Surface=cone.Cone)  # -> UDimension, VDimension
similar = Similarity(FirstNumber=dim.VDimension, SecondNumber=dim_2.VDimension, Threshold=0.1)  # -> Similarity, AbsoluteDifference
similar_2 = Similarity(FirstNumber=dim.UDimension, SecondNumber=dim_2.UDimension, Threshold=0.1)  # -> Similarity, AbsoluteDifference
and = GateAnd(A=similar.Similarity, B=similar_2.Similarity)
cull = CullPattern(List=debrep_2.Faces, CullPattern=and)  # -> flatten(List)

end = EndPoints(Curve=anchors)  # -> Start, End
avr = Average(Input=vec)
avr_2 = Average(Input=end.Start)
pl = PlaneNormal(Origin=avr_2, ZAxis=avr)

srf = Surface(cone.Cone)
srf_2 = Surface(debrep.Faces)
untrim_2 = Untrim(Surface=srf_2)
dim_3 = Dimensions(Surface=untrim_2)  # -> UDimension, VDimension
dim_4 = Dimensions(Surface=srf)  # -> UDimension, VDimension
similar_3 = Similarity(FirstNumber=dim_3.VDimension, SecondNumber=dim_4.VDimension, Threshold=0.1)  # -> Similarity, AbsoluteDifference
similar_4 = Similarity(FirstNumber=dim_3.UDimension, SecondNumber=dim_4.UDimension, Threshold=0.1)  # -> Similarity, AbsoluteDifference
and_2 = GateAnd(A=similar_3.Similarity, B=similar_4.Similarity)
cull_2 = CullPattern(List=srf_2, CullPattern=and_2)
join = BrepJoin(Breps=cull_2)  # -> Breps, Closed

project = Project(Geometry=cull, Plane=pl)  # -> Geometry, Transform
edges = BrepEdges(Brep=project.Geometry)  # -> Naked, Interior, NonManifold
join_2 = JoinCurves(Curves=flatten(edges.Naked), Preserve=False)
runion = RegionUnion(Curves=flatten(join_2))
boundary = BoundarySurfaces(Edges=runion)
area = Area(Geometry=runion)  # -> Area, Centroid

# ---- group: Conic Area
area_2 = Area(Geometry=join.Breps)  # -> Area, Centroid
ma = MassAddition(Input=flatten(area_2.Area))  # -> Result, PartialResults
wav = WeightedAverage(Input=flatten(area_2.Centroid), Weights=flatten(area_2.Area))

# ----
ma_2 = MassAddition(Input=area.Area)  # -> Result, PartialResults
bool = Boolean(calculate_3d_cones)
num = Number(0)
filter = StreamFilter(Gate=bool, Stream0=boundary, Stream1=join.Breps)
filter_2 = StreamFilter(Gate=bool, Stream0=num, Stream1=ma.Result)

failure_cones = ClusterOutput(filter)  # The area over which the concrete is predicted to fail
projected_area = ClusterOutput(ma_2.Result)  # Projected area of failure surface
conic_area = ClusterOutput(filter_2)  # Area of Failure Surface
